# Dynamo graph Dynamo_MLP_code_for_housing_final.dyn "Dynamo_MLP_code_for_housing1" (Dynamo 2.10.1.3976)

# group: Rooms
categories = Categories("OST_Rooms")
all_elements_of_category = ElementsOfCategory(Category=categories)

# group: Room number
number = Room.Number(room=all_elements_of_category)

# group: Name of columns in DataFrame
string = StringInput("room_number")
string_2 = StringInput("space_id")
string_3 = StringInput("label")
string_4 = StringInput("areas")
string_5 = StringInput("volumes")
string_6 = StringInput("perimeter")
string_7 = StringInput("X")
string_8 = StringInput("Y")
string_9 = StringInput("Z")
string_10 = StringInput("aspect_ratio")
string_11 = StringInput("boundary_line")
string_12 = StringInput("surface_areas")
string_13 = StringInput("ax1s")
list_create = List.Create(item0=string_2, item1=string_3, item2=string_4, item3=string_5, item4=string_6, item5=string_7, item6=string_8, item7=string_9, item8=string_10, item9=string_11, item10=string_12, item11=string_13)
watch = Watch(list_create)

string_14 = StringInput("AD/PD")
string_15 = StringInput("Balcony")
string_16 = StringInput("Bathroom")
string_17 = StringInput("Bedroom")
string_18 = StringInput("Dressing room")
string_19 = StringInput("Entrance")
string_20 = StringInput("Evacuation room")
string_21 = StringInput("Kitchen")
string_22 = StringInput("Living room")
string_23 = StringInput("Storage")
string_24 = StringInput("Hallway")
list_create_2 = List.Create(item0=string_14, item1=string_15, item2=string_16, item3=string_17, item4=string_18, item5=string_19, item6=string_20, item7=string_21, item8=string_22, item9=string_23, item10=string_24)
string_25 = StringInput("C:\Users/JINHYEOK/Desktop/test1.xlsx")
string_26 = StringInput("Features")
code_block = CodeBlock { 0; }

# group: GUID
GUID = Python(IN[0]=all_elements_of_category)  # CPython3
# ---------- GUID.python (39 lines) ----------
import clr

# Import RevitAPI
clr.AddReference("RevitAPI")
import Autodesk

clr.AddReference("RevitNodes")
import Revit

# Import DocumentManager and TransactionManager
clr.AddReference("RevitServices")
import RevitServices
from RevitServices.Persistence import DocumentManager
from RevitServices.Transactions import TransactionManager

# Import geometry conversion extension methods
clr.ImportExtensions(Revit.GeometryConversion)

# Import Element wrapper extension methods
clr.ImportExtensions(Revit.Elements)

# Unwrap the Point, yielding a Revit XYZ in Revit unit system

def toRvtId(_id):
	if isinstance(_id, int) or isinstance(_id, str):
		id = Autodesk.Revit.DB.ElementId(int(_id))
		return id
	elif isinstance(_id, Autodesk.Revit.DB.ElementId):
		return _id
element = UnwrapElement(IN[0])
ID = []
GUID = []
for i in element:
	GUID.append(i.UniqueId)
#for i in IN[0]:
#	a = toRvtId(i)
#	ID.append(a)

OUT = GUID
# ----------------------------------------

# group: Room name
name = Room.Name(room=all_elements_of_category)

# group: Areas
area = Room.Area(room=all_elements_of_category)
area_2 = CodeBlock(n=area) { DSCore.Math.Round(n,3); }

# group: Volumes
volume = Room.Volume(room=all_elements_of_category)
volume_2 = CodeBlock(n=volume) { DSCore.Math.Round(n,3); }

# group: Perimeter
coreBoundary = Room.CoreBoundary(room=all_elements_of_category)
byJoinedCurves = PolyCurve.ByJoinedCurves(curves=coreBoundary@L2)
byPatch = Surface.ByPatch(closedCurve=byJoinedCurves)
perimeter = Surface.Perimeter(surface=byPatch)

convert_between_units = DynamoConvert(perimeter, MeasurementType="Length", FromConversion="Millimeters", ToConversion="Meters")

# group (continued): Perimeter
perimeter_2 = CodeBlock(n=convert_between_units) { DSCore.Math.Round(n,2); }

boundingBox = Element.BoundingBox(element=all_elements_of_category)
toCuboid = BoundingBox.ToCuboid(boundingBox=boundingBox)

# group: X
width = Cuboid.Width(cuboid=toCuboid)

convert_between_units_2 = DynamoConvert(width, MeasurementType="Length", FromConversion="Millimeters", ToConversion="Meters")

# group (continued): X
x_width_of_boundingbox = CodeBlock(n=convert_between_units_2) { DSCore.Math.Round(n,3); }

# group: Y
length = Cuboid.Length(cuboid=toCuboid)

convert_between_units_3 = DynamoConvert(length, MeasurementType="Length", FromConversion="Millimeters", ToConversion="Meters")

# group (continued): Y
y_length_of_boundingbox = CodeBlock(n=convert_between_units_3) { DSCore.Math.Round(n,3); }

# group: Z
height = Cuboid.Height(cuboid=toCuboid)

convert_between_units_4 = DynamoConvert(height, MeasurementType="Length", FromConversion="Millimeters", ToConversion="Meters")

# group (continued): Z
z_height_of_boundingbox = CodeBlock(n=convert_between_units_4) { DSCore.Math.Round(n,3); }

# group: Aspect ratio
aspect_ratio = CodeBlock(length=y_length_of_boundingbox, width=x_width_of_boundingbox) { DSCore.Math.Round(length/width, 9); }

# group: Surface area
geometry = Element.Geometry(element=all_elements_of_category)
area_3 = Solid.Area(solid=geometry)

convert_between_units_5 = DynamoConvert(area_3, MeasurementType="Area", FromConversion="SquareMillimeter", ToConversion="SquareMeter")

# group (continued): Surface area
flatten = List.Flatten(list=convert_between_units_5)
surface_area = CodeBlock(n=flatten) { DSCore.Math.Round(n,3); }

# group: No. of boundary line
count = List.Count(list=coreBoundary@L2)

# group: ax1s
ax1s = CodeBlock(area=surface_area, volume=volume) { DSCore.Math.Round(area/volume, 9); }

# group: Preprocessed dataset for create DataFrame
list_create_3 = List.Create(item0=GUID, item1=name, item2=area_2, item3=volume_2, item4=perimeter_2, item5=x_width_of_boundingbox, item6=y_length_of_boundingbox, item7=z_height_of_boundingbox, item8=aspect_ratio, item9=surface_area, item10=count, item11=ax1s)
watch_2 = Watch(list_create_3)
transpose = List.Transpose(lists=watch_2)

exportExcel = Data.ExportExcel(filePath=string_25, sheetName=string_26, startRow=code_block, startCol=code_block, data=transpose)
