# Dynamo graph Dynamo_MLP_housing.dyn (Dynamo 2.13.1.3887)
# packages: Rhythm 2022.9.1, Clockwork for Dynamo 2.x 2.4.0

# group: Rooms
categories = Categories("OST_Rooms")
all_elements_of_category = ElementsOfCategory(Category=categories)

# group: Refresher
refresher = BoolSelector(true)
if_ = RefactoredIf(test=refresher, true=all_elements_of_category, false=all_elements_of_category)

# group: Room number
number = Room.Number(room=if_)

# group: Name of columns in DataFrame
string = StringInput("room_number")
string_2 = StringInput("space_id")
string_3 = StringInput("label")
string_4 = StringInput("areas")
string_5 = StringInput("volumes")
string_6 = StringInput("perimeter")
string_7 = StringInput("X")
string_8 = StringInput("Y")
string_9 = StringInput("Z")
string_10 = StringInput("aspect_ratio")
string_11 = StringInput("boundary_line")
string_12 = StringInput("surface_areas")
string_13 = StringInput("ax1s")
list_create = List.Create(item0=string_2, item1=string_3, item2=string_4, item3=string_5, item4=string_6, item5=string_7, item6=string_8, item7=string_9, item8=string_10, item9=string_11, item10=string_12, item11=string_13)
watch = Watch(list_create)

# group: Pretrained model_MLP
pretrained_model = StringInput("Dynamo_MLP_code_for_housing_221110")

# group: GUID
GUID = Python(IN[0]=if_)  # CPython3
# ---------- GUID.python (39 lines) ----------
import clr

# Import RevitAPI
clr.AddReference("RevitAPI")
import Autodesk

clr.AddReference("RevitNodes")
import Revit

# Import DocumentManager and TransactionManager
clr.AddReference("RevitServices")
import RevitServices
from RevitServices.Persistence import DocumentManager
from RevitServices.Transactions import TransactionManager

# Import geometry conversion extension methods
clr.ImportExtensions(Revit.GeometryConversion)

# Import Element wrapper extension methods
clr.ImportExtensions(Revit.Elements)

# Unwrap the Point, yielding a Revit XYZ in Revit unit system

def toRvtId(_id):
	if isinstance(_id, int) or isinstance(_id, str):
		id = Autodesk.Revit.DB.ElementId(int(_id))
		return id
	elif isinstance(_id, Autodesk.Revit.DB.ElementId):
		return _id
element = UnwrapElement(IN[0])
ID = []
GUID = []
for i in element:
	GUID.append(i.UniqueId)
#for i in IN[0]:
#	a = toRvtId(i)
#	ID.append(a)

OUT = GUID
# ----------------------------------------

# group: Room name
name = Room.Name(room=if_)

# group: Areas
area = Room.Area(room=if_)
area_2 = CodeBlock(n=area) { DSCore.Math.Round(n,3); }

# group: Volumes
volume = Room.Volume(room=if_)
volume_2 = CodeBlock(n=volume) { DSCore.Math.Round(n,3); }

# group: Perimeter
coreBoundary = Room.CoreBoundary(room=if_)
byJoinedCurves = PolyCurve.ByJoinedCurves(curves=coreBoundary@L2)
byPatch = Surface.ByPatch(closedCurve=byJoinedCurves)
perimeter = Surface.Perimeter(surface=byPatch)
convert_by_units = DynamoUnitConvert(perimeter, MeasurementType="autodesk.unit.quantity:length-1.0.4", FromConversion="autodesk.unit.unit:millimeters-1.0.1", ToConversion="autodesk.unit.unit:meters-1.0.0")
perimeter_2 = CodeBlock(n=convert_by_units) { DSCore.Math.Round(n,0); }

boundingBox = Element.BoundingBox(element=if_)
toCuboid = BoundingBox.ToCuboid(boundingBox=boundingBox)

# group: X
width = Cuboid.Width(cuboid=toCuboid)
x_width_of_boundingbox = CodeBlock(n=width) { DSCore.Math.Round(n,3); }

# group: Y
length = Cuboid.Length(cuboid=toCuboid)
y_length_of_boundingbox = CodeBlock(n=length) { DSCore.Math.Round(n,3); }

# group: Z
height = Cuboid.Height(cuboid=toCuboid)
z_height_of_boundingbox = CodeBlock(n=height) { DSCore.Math.Round(n,3); }

# group: Aspect ratio
aspect_ratio = CodeBlock(length=y_length_of_boundingbox, width=x_width_of_boundingbox) { DSCore.Math.Round(length/width, 9); }

# group: Surface area
geometry = Element.Geometry(element=if_)
area_3 = Solid.Area(solid=geometry)
convert_by_units_2 = DynamoUnitConvert(area_3, MeasurementType="autodesk.unit.quantity:area-1.0.2", FromConversion="autodesk.unit.unit:squareMillimeters-1.0.1", ToConversion="autodesk.unit.unit:squareMeters-1.0.1")
flatten = List.Flatten(list=convert_by_units_2)
surface_area = CodeBlock(n=flatten) { DSCore.Math.Round(n,3); }

# group: No. of boundary line
count = List.Count(list=coreBoundary@L2)

# group: ax1s
ax1s = CodeBlock(volume=volume, surface_area=flatten) { DSCore.Math.Round(volume/surface_area, 9); }

# group: Preprocessed dataset for create DataFrame
list_create_2 = List.Create(item0=GUID, item1=name, item2=area_2, item3=volume_2, item4=perimeter_2, item5=x_width_of_boundingbox, item6=y_length_of_boundingbox, item7=z_height_of_boundingbox, item8=aspect_ratio, item9=surface_area, item10=count, item11=ax1s)
watch_2 = Watch(list_create_2)
transpose = List.Transpose(lists=watch_2)

# group: Doors in rooms
doors = Custom[Room.Doors](room=if_)  # package Clockwork for Dynamo 2.x; Retrieves all doors that are associated with a room (hosted in walls and roofs).
watch_3 = Watch(doors)

# group: Get name & GUID
count_2 = List.Count(list=watch_3@L2)
cycle = List.Cycle(list=if_, amount=count_2, lacing=Shortest)
GUID_2 = Python(IN[0]=cycle)  # CPython3
# ---------- GUID_2.python (43 lines) ----------
import clr

# Import RevitAPI
clr.AddReference("RevitAPI")
import Autodesk

clr.AddReference("RevitNodes")
import Revit

# Import DocumentManager and TransactionManager
clr.AddReference("RevitServices")
import RevitServices
from RevitServices.Persistence import DocumentManager
from RevitServices.Transactions import TransactionManager

# Import geometry conversion extension methods
clr.ImportExtensions(Revit.GeometryConversion)

# Import Element wrapper extension methods
clr.ImportExtensions(Revit.Elements)

# Unwrap the Point, yielding a Revit XYZ in Revit unit system

def toRvtId(_id):
	if isinstance(_id, int) or isinstance(_id, str):
		id = Autodesk.Revit.DB.ElementId(int(_id))
		return id
	elif isinstance(_id, Autodesk.Revit.DB.ElementId):
		return _id
		
element = UnwrapElement(IN[0])
ID = []
GUID = []
for i in element:
    GUID_ = []
    for j in i:
        GUID_.append(j.UniqueId)
    GUID.append(GUID_)
#for i in IN[0]:
#	a = toRvtId(i)
#	ID.append(a)

OUT = GUID
# ----------------------------------------
GUID_3 = Python(IN[0]=watch_3)  # CPython3; same code as GUID_2
name_2 = Room.Name(room=cycle)

string_from_object = FromObject(object=cycle)

# group: Door label name
code_block = CodeBlock { "작업"; }
ʳʰʸᵗʰᵐ_elements = Rhythm.Revit.Elements.Elements.GetParameterValueByNameTypeOrInstance(element=watch_3, parameterName=code_block)
code_block_2 = CodeBlock { 6; }
length_2 = String.Length(string=ʳʰʸᵗʰᵐ_elements)
code_block_3 = CodeBlock(a=length_2, b=code_block_2) { a-b; }
remove = String.Remove(string=ʳʰʸᵗʰᵐ_elements, startIndex=code_block_2, count=code_block_3)
toLower = String.ToLower(string=remove)
toTitle = String.ToTitle(str=toLower)
code_block_4 = CodeBlock(st=toTitle) { st == "Single"? "Single":st == "Double"? "Double":"others"; }
code_block_5 = CodeBlock { "Door"; }
add = code_block_4 + code_block_5  # lacing=CrossProduct
string_from_object_2 = FromObject(object=watch_3)
code_block_6 = CodeBlock { "목재"; }
contains = String.Contains(string=string_from_object_2, searchFor=code_block_6)
code_block_7 = CodeBlock(bool_test=contains) { bool_test? "Wood":"Steel"; }
add_2 = code_block_4 + code_block_7

# group: Output for Door
list_create_3 = List.Create(item0=GUID_2, item1=string_from_object, item2=GUID_3, item3=add)
flatten_2 = List.Flatten(list=list_create_3@@L3)

# group: Windows in rooms
windows = Custom[Room.Windows](room=if_)  # package Clockwork for Dynamo 2.x; Retrieves all windows that are associated with a room (hosted in walls and roofs).
watch_4 = Watch(windows)

# group: Get name & GUID
count_3 = List.Count(list=watch_4@L2)
cycle_2 = List.Cycle(list=if_, amount=count_3, lacing=Shortest)
GUID_4 = Python(IN[0]=cycle_2)  # CPython3; same code as GUID_2
GUID_5 = Python(IN[0]=watch_4)  # CPython3; same code as GUID_2
name_3 = Room.Name(room=cycle_2)

string_from_object_3 = FromObject(object=cycle_2)

# group: Window label name
code_block_8 = CodeBlock { "작업"; }
ʳʰʸᵗʰᵐ_elements_2 = Rhythm.Revit.Elements.Elements.GetParameterValueByNameTypeOrInstance(element=watch_4, parameterName=code_block_8)
code_block_9 = CodeBlock { 6; }
length_3 = String.Length(string=ʳʰʸᵗʰᵐ_elements_2)
code_block_10 = CodeBlock(a=length_3, b=code_block_9) { a-b; }
remove_2 = String.Remove(string=ʳʰʸᵗʰᵐ_elements_2, startIndex=code_block_9, count=code_block_10)
code_block_11 = CodeBlock { "Window"; }
add_3 = remove_2 + code_block_11  # lacing=CrossProduct

# group: Output for Window
list_create_4 = List.Create(item0=GUID_4, item1=string_from_object_3, item2=GUID_5, item3=add_3)
flatten_3 = List.Flatten(list=list_create_4@@L3)

# group: Edge data preprocessing
list_create_5 = List.Create(item0=flatten_2, item1=flatten_3)
transpose_2 = List.Transpose(lists=list_create_5)
flatten_4 = List.Flatten(list=transpose_2@@L3)
transpose_3 = List.Transpose(lists=flatten_4)

# group: Room labels (11 of roomtypes)
string_14 = StringInput("AD/PD")
string_15 = StringInput("Balcony")
string_16 = StringInput("Bathroom")
string_17 = StringInput("Bedroom")
string_18 = StringInput("Dressing room")
string_19 = StringInput("Entrance")
string_20 = StringInput("Evacuation room")
string_21 = StringInput("Kitchen")
string_22 = StringInput("Living room")
string_23 = StringInput("Storage")
string_24 = StringInput("Hallway")
list_create_6 = List.Create(item0=string_14, item1=string_15, item2=string_16, item3=string_17, item4=string_18, item5=string_19, item6=string_20, item7=string_21, item8=string_22, item9=string_23, item10=string_24)

# group: MLP for Dynamo using external saved model
MLP = Python(IN[0]=pretrained_model, IN[1]=watch, IN[2]=transpose, IN[3]=transpose_3, IN[4]=list_create_6)  # CPython3
# ---------- MLP.python (106 lines) ----------
# This code have been edited by Daemok Ha, 2022

import sys
import os
import clr
clr.AddReference('DynamoServices')
from Dynamo.Events import *

# Put these codes below first to use virtual environment you made and python packages you installed
#vir_envs = r"C:\Users\%USERNAME%\anaconda3\envs"
name_of_envs = "anaconda3\envs\mlp_dmh" # could be customized
sys.path.append(os.path.join(os.getenv('USERPROFILE'), name_of_envs, r"Lib\site-packages"))

# And then import packages from the path where python(version import pickle as pkl)
#force to reload module
if "tensorflow" in sys.modules:
    del sys.modules["tensorflow"]
    
import numpy as np
import pickle as pkl
import pandas as pd
import warnings; warnings.filterwarnings('ignore')
from sklearn.preprocessing import RobustScaler
# To save the model
import joblib

scaler = RobustScaler()

# Load the pickled model
dyn_path = ExecutionEvents.ActiveSession.CurrentWorkspacePath
base_dir = os.path.dirname(dyn_path)

#loaded_model = joblib.load(os.path.join(base_dir, r"Dynamo_MLP_code_for_housing.pkl"))
loaded_model = joblib.load(os.path.join(base_dir, IN[0]+'.pkl'))

data = pd.DataFrame(data= IN[2], columns = IN[1])

#data= pd.read_csv(r"C:\Users\DaemokHa\Desktop\DB_test\MLP_code_220929\Dynamo_MLP_test.csv", encoding = "cp949")

data = data[['space_id','areas', 'volumes','perimeter', 'X', 'Y', 'Z', 'aspect_ratio', 'boundary_line','surface_areas', 'ax1s', 'label']]
data_ = data.rename(columns={'space_id':'id'})
data_pre = data_.iloc[:,1:-1]

X_dyn_test = data_pre.values
robust = scaler.fit_transform(X_dyn_test)
data_robs = pd.DataFrame(robust)

# Edge data preprocessing(with boolean)
id2ind = dict(zip(data_.iloc[:,0], data_.index))
elist = pd.DataFrame(IN[3])
elist = elist.iloc[:, :4]
elist = elist.rename(columns={0:'s1', 1:'s1_label', 2:'s2', 3:'s2_label'})

id2type = dict(zip(elist.s1, elist.s1_label))
id2type_toadd = dict(zip(elist.s2, elist.s2_label))
id2type.update(id2type_toadd)
column_names = np.unique(list(np.unique(elist.s1_label)) + list(np.unique(elist.s2_label)))
adj_feat= pd.DataFrame(0, index=data_['id'].values, columns=column_names)

for i in elist.index:   
    s1_id = elist.iloc[i]['s1']
    s2_id = elist.iloc[i]['s2']

    try:
        s1_adj_type = id2type[s2_id]
        # s2_adj_type = id2type[s1_id]

        adj_feat.loc[s1_id, s1_adj_type] += 1
        # adj_feat.loc[s2_id, s2_adj_type] += 1

    except KeyError:
        continue

# add the adj_feature to the previous feature as binary
adj_feat_pre = adj_feat.copy()
adj_feat_pre[adj_feat_pre != 0] = 1
adj_feat_pre = adj_feat_pre.drop(['Room'], axis = 1)
feat_bin = pd.concat([data_robs, adj_feat_pre.reset_index(drop=True)], axis=1)

X_dyn_test = feat_bin
y_dyn_test = data_.iloc[:,-1]

# Use the loaded pickled model to make predictions
# y_pred = clf2.predict(X_test)
y_pred = loaded_model.predict(X_dyn_test)

labels = np.unique(y_dyn_test)

predictions = loaded_model.predict_proba(X_dyn_test)
df = pd.DataFrame.from_dict(predictions)

predicted_label = pd.DataFrame(df.idxmax(axis=1), columns=['Pred_labels'])

list_name = IN[4]
list_label = range(len(list_name))

#dic_replace = dict(zip(list_label, list_name))

#name_list = []
#for lbls in y_test_baseline:
    #name_list.append(dic_replace[lbls])

df['Pred_labels'] = predicted_label.replace(list_label, list_name)
#df['True_labels'] = name_list

OUT = data_['id'].to_list(), df['Pred_labels'].to_list();
# ----------------------------------------
transpose_4 = List.Transpose(lists=MLP)

code_block_12 = CodeBlock(result=transpose_4) { result<3>; result<1>; }
deconstruct = List.Deconstruct(list=transpose_4@L2)
python_script = Python(IN[0]=deconstruct.first)  # CPython3
# ---------- python_script.python (28 lines) ----------
import clr
clr.AddReference('ProtoGeometry')
from Autodesk.DesignScript.Geometry import *

clr.AddReference("RevitNodes")
import Revit
clr.ImportExtensions(Revit.Elements)

clr.AddReference("RevitServices")
import RevitServices
from RevitServices.Persistence import DocumentManager
from RevitServices.Transactions import TransactionManager

from System.Collections.Generic import *

clr.AddReference("RevitAPI")
import Autodesk
from Autodesk.Revit.DB import *

doc = DocumentManager.Instance.CurrentDBDocument

ids = IN[0]
elements = []

for i in ids:
		elements.append(doc.GetElement(i).ToDSType(True))

OUT = elements
# ----------------------------------------

# group: change room names
code_block_13 = CodeBlock { "이름"; }
setParameterByName = Element.SetParameterByName(element=python_script, parameterName=code_block_13, value=deconstruct.rest)

python_script_2 = Python()  # CPython3; unwired: IN[0]
# ---------- python_script_2.python (31 lines) ----------
# This code have been edited by Daemok Ha, 2022

import sys
import os
import clr
clr.AddReference('DynamoServices')
from Dynamo.Events import *

# Put these codes below first to use virtual environment you made and python packages you installed
#vir_envs = r"C:\Users\%USERNAME%\anaconda3\envs"
name_of_envs = "anaconda3\envs\mlp_dmh" # could be customized
sys.path.append(os.path.join(os.getenv('USERPROFILE'), name_of_envs, r"Lib\site-packages"))


import pandas as pd

dataFrame = pd.DataFrame({
	"Name": ["Odinson, Thor",
		"Maximoff, Wanda",
		"Banner, Dr. Bruce",
		"Romanoff, Natasha",
		"Stark, Tony",
		"Danvers, Carol ",
		"Rogers, Steve"],
	"Age": [1505, 24, 54, 39, 53, 65, 38],
	"Sex": ["male","female","male",
		"female","male","female",
		"male"]
})

OUT = repr(dataFrame)
# ----------------------------------------
