# Dynamo graph Extract_space_element_adj_final.dyn (Dynamo 2.13.1.3887)
# packages: Rhythm 2022.9.1, Clockwork for Dynamo 2.x 2.4.0, Orchid 213.2.0.8306, archi-lab.net 2023.213.1622

# note: CSV로 공간 - 부재 관계정보가
# 침실 - singlewooddoor (가능하면 operation type(single, double, 나머지 다 others), material 정보(목재 = wood, 나머지 다 Steel)
# 침실 - SingleWindow (가능하면 Panel 개수에 따른 single, double, triple, qudraple)
# 이런 느낌으로
# 그래서 전체 부재 레이블은 Door(single, double, others ...), Window(single, double ...), Flowterminal, Furniture  elements
# note: Window 2개 문3개 flow, furnishing

# group: Room
categories = Categories("OST_Rooms")
all_elements_of_category = ElementsOfCategory(Category=categories)

doors = Custom[Room.Doors](room=all_elements_of_category)  # package Clockwork for Dynamo 2.x; Retrieves all doors that are associated with a room (hosted in walls and roofs).
isEmpty = List.IsEmpty(list=doors@L2)
filterByBoolMask = List.FilterByBoolMask(list=doors, mask=isEmpty)

# group: Door
watch = Watch(filterByBoolMask.out)

count = List.Count(list=watch@L2)
cycle = List.Cycle(list=all_elements_of_category, amount=count, lacing=Shortest)

# group: IfcGUID for Room with door
code_block = CodeBlock { "IfcGUID"; }
ʳʰʸᵗʰᵐ_elements = Rhythm.Revit.Elements.Elements.GetParameterValueByNameTypeOrInstance(element=cycle, parameterName=code_block)

windows = Custom[Room.Windows](room=all_elements_of_category)  # package Clockwork for Dynamo 2.x; Retrieves all windows that are associated with a room (hosted in walls and roofs).
isEmpty_2 = List.IsEmpty(list=windows@L2)
filterByBoolMask_2 = List.FilterByBoolMask(list=windows, mask=isEmpty_2)

# group: Window
watch_2 = Watch(filterByBoolMask_2.out)

count_2 = List.Count(list=watch_2@L2)
cycle_2 = List.Cycle(list=all_elements_of_category, amount=count_2, lacing=Shortest)

# group: IfcGUID for Room with window
code_block_2 = CodeBlock { "IfcGUID"; }
ʳʰʸᵗʰᵐ_elements_2 = Rhythm.Revit.Elements.Elements.GetParameterValueByNameTypeOrInstance(element=cycle_2, parameterName=code_block_2)

code_block_3 = CodeBlock { "레벨"; }
getParameterValueByName = Element.GetParameterValueByName(element=all_elements_of_category, parameterName=code_block_3)
byName = Orchid.RevitProject.Datums.Level.ByName(name=getParameterValueByName)
all = Orchid.RevitProject.Datums.Level.All()
list_create = List.Create(item0=all_elements_of_category, item1=all)
groupByKey = List.GroupByKey(list=list_create)  # unwired: keys
uniqueItems = List.UniqueItems(list=all)
all_elements_at_level = ElementsAtLevel(Level=uniqueItems)
getCategory = Element.GetCategory(element=all_elements_at_level)
string_from_object = FromObject(object=getCategory)
code_block_4 = CodeBlock(cat=string_from_object) { cat =="룸"? true:false; }
filterByBoolMask_3 = List.FilterByBoolMask(list=all_elements_at_level, mask=code_block_4)
isEmpty_3 = List.IsEmpty(list=filterByBoolMask_3.in@L2)
filterByBoolMask_4 = List.FilterByBoolMask(list=filterByBoolMask_3.in, mask=isEmpty_3)
watch_3 = Watch(filterByBoolMask_4.out)

# group: Label: Flowterminal, Funiture
code_block_5 = CodeBlock { "위생기구"; }
code_block_6 = CodeBlock { "가구"; }
list_create_2 = List.Create(item0=code_block_5, item1=code_block_6)

contains = List.Contains(list=string_from_object@@L1, item=list_create_2, lacing=CrossProduct)
anyTrue = List.AnyTrue(list=contains@@L2)
filterByBoolMask_5 = List.FilterByBoolMask(list=all_elements_at_level, mask=anyTrue)
watch_4 = Watch(filterByBoolMask_5.in)
elements_in_room = Custom[Elements in Room](elements=watch_4@L2, rooms=watch_3@L2)  # package archi-lab.net; This node will check if any of the elements are inside any of the supplied rooms.
isEmpty_4 = List.IsEmpty(list=elements_in_room@@L2)
filterByBoolMask_6 = List.FilterByBoolMask(list=watch_3, mask=isEmpty_4)
watch_5 = Watch(filterByBoolMask_6.out)
filterByBoolMask_7 = List.FilterByBoolMask(list=elements_in_room, mask=isEmpty_4)
watch_6 = Watch(filterByBoolMask_7.out)
count_3 = List.Count(list=watch_6@@L2)
cycle_3 = List.Cycle(list=watch_5@@L1, amount=count_3@L1, lacing=Shortest)

# group: IfcGUID for Room with etc
code_block_7 = CodeBlock { "IfcGUID"; }
ʳʰʸᵗʰᵐ_elements_3 = Rhythm.Revit.Elements.Elements.GetParameterValueByNameTypeOrInstance(element=cycle_3, parameterName=code_block_7)

# group: Get GUID
GUID = Python(IN[0]=cycle)  # CPython3
# ---------- GUID.python (48 lines) ----------
import clr

# Import RevitAPI
clr.AddReference("RevitAPI")
import Autodesk

clr.AddReference("RevitNodes")
import Revit

# Import DocumentManager and TransactionManager
clr.AddReference("RevitServices")
import RevitServices
from RevitServices.Persistence import DocumentManager
from RevitServices.Transactions import TransactionManager

# Import geometry conversion extension methods
clr.ImportExtensions(Revit.GeometryConversion)

# Import Element wrapper extension methods
clr.ImportExtensions(Revit.Elements)

# Unwrap the Point, yielding a Revit XYZ in Revit unit system

def toRvtId(_id):
	if isinstance(_id, int) or isinstance(_id, str):
		id = Autodesk.Revit.DB.ElementId(int(_id))
		return id
	elif isinstance(_id, Autodesk.Revit.DB.ElementId):
		return _id
#element = UnwrapElement(IN[0])
#ID = []
#GUID = []
#for i in element:
#	GUID.append(i.UniqueId)
	
element = UnwrapElement(IN[0])
ID = []
GUID = []
for i in element:
    GUID_ = []
    for j in i:
        GUID_.append(j.UniqueId)
    GUID.append(GUID_)
#for i in IN[0]:
#	a = toRvtId(i)
#	ID.append(a)

OUT = GUID
# ----------------------------------------

# group: Room name
name = Room.Name(room=cycle)

# group: IfcGUID for Door
code_block_8 = CodeBlock { "IfcGUID"; }
ʳʰʸᵗʰᵐ_elements_4 = Rhythm.Revit.Elements.Elements.GetParameterValueByNameTypeOrInstance(element=watch, parameterName=code_block_8)

# group: Door label name
code_block_9 = CodeBlock { "작업"; }
ʳʰʸᵗʰᵐ_elements_5 = Rhythm.Revit.Elements.Elements.GetParameterValueByNameTypeOrInstance(element=watch, parameterName=code_block_9)
code_block_10 = CodeBlock { 6; }
length = String.Length(string=ʳʰʸᵗʰᵐ_elements_5)
code_block_11 = CodeBlock(a=length, b=code_block_10) { a-b; }
remove = String.Remove(string=ʳʰʸᵗʰᵐ_elements_5, startIndex=code_block_10, count=code_block_11)
toLower = String.ToLower(string=remove)
toTitle = String.ToTitle(str=toLower)
code_block_12 = CodeBlock(st=toTitle) { st == "Single"? "Single":st == "Double"? "Double":"others"; }
string_from_object_2 = FromObject(object=watch)
code_block_13 = CodeBlock { "목재"; }
contains_2 = String.Contains(string=string_from_object_2, searchFor=code_block_13)
code_block_14 = CodeBlock(bool_test=contains_2) { bool_test? "Wood":"Steel"; }
add = code_block_12 + code_block_14
code_block_15 = CodeBlock { "Door"; }
add_2 = add + code_block_15  # lacing=CrossProduct

# group: Output for Door
list_create_3 = List.Create(item0=GUID, item1=name, item2=ʳʰʸᵗʰᵐ_elements_4, item3=add_2)
flatten = List.Flatten(list=list_create_3@@L3)

# group: Get GUID
GUID_2 = Python(IN[0]=cycle_2)  # CPython3; same code as GUID

count_4 = List.Count(list=watch_2@L2)
cycle_4 = List.Cycle(list=all_elements_of_category, amount=count_4, lacing=Shortest)

# group: Room name
name_2 = Room.Name(room=cycle_4)

# group: IfcGUID for Window
code_block_16 = CodeBlock { "IfcGUID"; }
ʳʰʸᵗʰᵐ_elements_6 = Rhythm.Revit.Elements.Elements.GetParameterValueByNameTypeOrInstance(element=watch_2, parameterName=code_block_16)

# group: Window label name
code_block_17 = CodeBlock { "작업"; }
ʳʰʸᵗʰᵐ_elements_7 = Rhythm.Revit.Elements.Elements.GetParameterValueByNameTypeOrInstance(element=watch_2, parameterName=code_block_17)
code_block_18 = CodeBlock { 6; }
length_2 = String.Length(string=ʳʰʸᵗʰᵐ_elements_7)
code_block_19 = CodeBlock(a=length_2, b=code_block_18) { a-b; }
remove_2 = String.Remove(string=ʳʰʸᵗʰᵐ_elements_7, startIndex=code_block_18, count=code_block_19)
code_block_20 = CodeBlock { "Window"; }
add_3 = remove_2 + code_block_20  # lacing=CrossProduct

# group: Output for Window
list_create_4 = List.Create(item0=GUID_2, item1=name_2, item2=ʳʰʸᵗʰᵐ_elements_6, item3=add_3)
flatten_2 = List.Flatten(list=list_create_4@@L3)

# group: Get GUID
GUID_3 = Python(IN[0]=cycle_3)  # CPython3
# ---------- GUID_3.python (51 lines) ----------
import clr

# Import RevitAPI
clr.AddReference("RevitAPI")
import Autodesk

clr.AddReference("RevitNodes")
import Revit

# Import DocumentManager and TransactionManager
clr.AddReference("RevitServices")
import RevitServices
from RevitServices.Persistence import DocumentManager
from RevitServices.Transactions import TransactionManager

# Import geometry conversion extension methods
clr.ImportExtensions(Revit.GeometryConversion)

# Import Element wrapper extension methods
clr.ImportExtensions(Revit.Elements)

# Unwrap the Point, yielding a Revit XYZ in Revit unit system

def toRvtId(_id):
	if isinstance(_id, int) or isinstance(_id, str):
		id = Autodesk.Revit.DB.ElementId(int(_id))
		return id
	elif isinstance(_id, Autodesk.Revit.DB.ElementId):
		return _id
#element = UnwrapElement(IN[0])
#ID = []
#GUID = []
#for i in element:
#	GUID.append(i.UniqueId)
	
element = UnwrapElement(IN[0])
ID = []
GUID = []
for i in element:
    GUID_ = []
    for j in i:
        GUID__ = []
        for k in j:
              GUID__.append(k.UniqueId)
        GUID_.append(GUID__)
    GUID.append(GUID_)
#for i in IN[0]:
#	a = toRvtId(i)
#	ID.append(a)

OUT = GUID
# ----------------------------------------

name_3 = Room.Name(room=cycle_3)

# group: IfcGUID for etc
code_block_21 = CodeBlock { "IfcGUID"; }
ʳʰʸᵗʰᵐ_elements_8 = Rhythm.Revit.Elements.Elements.GetParameterValueByNameTypeOrInstance(element=watch_6, parameterName=code_block_21)

getCategory_2 = Element.GetCategory(element=watch_6)
string_from_object_3 = FromObject(object=getCategory_2)
code_block_22 = CodeBlock(cat=string_from_object_3) { cat == "위생기구"? "Flowterminal":"Furniture"; }

# group: Output for etc
list_create_5 = List.Create(item0=GUID_3, item1=name_3, item2=ʳʰʸᵗʰᵐ_elements_8, item3=code_block_22)
flatten_3 = List.Flatten(list=list_create_5@@L4)

# group: Final Output
list_create_6 = List.Create(item0=flatten, item1=flatten_2, item2=flatten_3)
transpose = List.Transpose(lists=list_create_6)
flatten_4 = List.Flatten(list=transpose@@L3)
transpose_2 = List.Transpose(lists=flatten_4)

# group: Export to Excel(.xlsx)
string = StringInput("C:\Users\JINHYEOK\Desktop\Space_element_adj.xlsx")
code_block_23 = CodeBlock { "Feature2"; }
code_block_24 = CodeBlock { 0; }
boolean = BoolSelector(true)
exportToExcel = Data.ExportToExcel(filePath=string, sheetName=code_block_23, startRow=code_block_24, startColumn=code_block_24, data=transpose_2, overWrite=boolean, writeAsString=boolean)
