# Dynamo graph change_door_operation_type.dyn (Dynamo 2.10.1.3976)

family_types = FamilyTypes("DR111-외여닫이문(철재, 방화문):DR111-외여닫이문(철재, 방화문) 900x2200mm")  # graph input
all_elements_of_family_type = ElementsOfFamilyType(Family_Type=family_types)
getFamily = FamilyInstance.GetFamily(familyInstance=all_elements_of_family_type)
types = Family.Types(family=getFamily)
code_block = CodeBlock { "작업"; }
string = StringInput("SINGLE_SWING_LEFT")  # graph input
setParameterByName = Element.SetParameterByName(element=types, parameterName=code_block, value=string)
