# Dynamo graph change_window_operation_type.dyn (Dynamo 2.10.1.3976)

family_types = FamilyTypes("WD315-두짝 미서기창(플라스틱):WD315-두짝 미서기창(플라스틱) 2000x1400mm(침실) 2")  # graph input
all_elements_of_family_type = ElementsOfFamilyType(Family_Type=family_types)
getFamily = FamilyInstance.GetFamily(familyInstance=all_elements_of_family_type)
types = Family.Types(family=getFamily)
code_block = CodeBlock { "작업"; }
string = StringInput("DoublePanelVertical")  # graph input
setParameterByName = Element.SetParameterByName(element=types, parameterName=code_block, value=string)
