# Dynamo graph extract_graph_relationship1.dyn (Dynamo 2.10.1.3976)
# packages: Crumple 2021.8.17

# group: refresh
boolean = BoolSelector(true)

categories = Categories("OST_Rooms")
all_elements_of_category = ElementsOfCategory(Category=categories)
GUID = Python(IN[0]=all_elements_of_category)  # CPython3
# ---------- GUID.python (39 lines) ----------
import clr

# Import RevitAPI
clr.AddReference("RevitAPI")
import Autodesk

clr.AddReference("RevitNodes")
import Revit

# Import DocumentManager and TransactionManager
clr.AddReference("RevitServices")
import RevitServices
from RevitServices.Persistence import DocumentManager
from RevitServices.Transactions import TransactionManager

# Import geometry conversion extension methods
clr.ImportExtensions(Revit.GeometryConversion)

# Import Element wrapper extension methods
clr.ImportExtensions(Revit.Elements)

# Unwrap the Point, yielding a Revit XYZ in Revit unit system

def toRvtId(_id):
	if isinstance(_id, int) or isinstance(_id, str):
		id = Autodesk.Revit.DB.ElementId(int(_id))
		return id
	elif isinstance(_id, Autodesk.Revit.DB.ElementId):
		return _id
element = UnwrapElement(IN[0])
ID = []
GUID = []
for i in element:
	GUID.append(i.UniqueId)
#for i in IN[0]:
#	a = toRvtId(i)
#	ID.append(a)

OUT = GUID
# ----------------------------------------
roomboundaries = Custom[© RoomBoundaries](room=all_elements_of_category)  # package Crumple
byJoinedCurves = PolyCurve.ByJoinedCurves(curves=roomboundaries)

# group: offset
code_block = CodeBlock { 100; }

boolean_2 = BoolSelector(false)
offset = PolyCurve.Offset(polyCurve=byJoinedCurves, signedDistance=code_block, extendCircular=boolean_2)
byPatch = Surface.ByPatch(closedCurve=offset)
code_block_2 = CodeBlock { "한계 간격띄우기"; }
getParameterValueByName = Element.GetParameterValueByName(element=all_elements_of_category, parameterName=code_block_2)
thicken = Surface.Thicken(surface=byPatch, thickness=getParameterValueByName)
doesIntersect = Geometry.DoesIntersect(geometry=thicken, other=thicken, lacing=CrossProduct)
filterByBoolMask = List.FilterByBoolMask(list=all_elements_of_category, mask=doesIntersect@L2)
watch = Watch(filterByBoolMask.in)
name = Room.Name(room=all_elements_of_category)
name_2 = Room.Name(room=watch)
eq = name == name_2
filterByBoolMask_2 = List.FilterByBoolMask(list=watch, mask=eq)
watch_2 = Watch(filterByBoolMask_2.out)

# group: 2nd
GUID_for_list = Python(IN[0]=watch_2)  # CPython3
# ---------- GUID_for_list.python (49 lines) ----------
import clr

# Import RevitAPI
clr.AddReference("RevitAPI")
import Autodesk

clr.AddReference("RevitNodes")
import Revit

# Import DocumentManager and TransactionManager
clr.AddReference("RevitServices")
import RevitServices
from RevitServices.Persistence import DocumentManager
from RevitServices.Transactions import TransactionManager

# Import geometry conversion extension methods
clr.ImportExtensions(Revit.GeometryConversion)

# Import Element wrapper extension methods
clr.ImportExtensions(Revit.Elements)

# Unwrap the Point, yielding a Revit XYZ in Revit unit system

def toRvtId(_id):
	if isinstance(_id, int) or isinstance(_id, str):
		id = Autodesk.Revit.DB.ElementId(int(_id))
		return id
	elif isinstance(_id, Autodesk.Revit.DB.ElementId):
		return _id
element = UnwrapElement(IN[0])

ID = []
for i in element:
    GUID = []
    for j in i:
        GUID.append(j.UniqueId)
    ID.append(GUID)

OUT = ID
#ID = []
#GUID = []
#for i in element:
#	GUID.append(i.UniqueId)

#for i in IN[0]:
#	a = toRvtId(i)
#	ID.append(a)

#OUT = GUID
# ----------------------------------------

count = List.Count(list=GUID_for_list@L2)

# group: 1st
cycle = List.Cycle(list=GUID, amount=count, lacing=Shortest)

flatten = List.Flatten(list=cycle)
flatten_2 = List.Flatten(list=GUID_for_list)
list_create = List.Create(item0=flatten, item1=flatten_2)
transpose = List.Transpose(lists=list_create)
code_block_3 = CodeBlock { false; }
if_ = If(test=boolean, true=transpose, false=code_block_3)

# group: export to excel
string = StringInput("./Extract_graph.xlsx")
string_2 = StringInput("relationship")
code_block_4 = CodeBlock { 0; }
boolean_3 = BoolSelector(true)
exportExcel = Data.ExportExcel(filePath=string, sheetName=string_2, startRow=code_block_4, startCol=code_block_4, data=if_, overWrite=boolean_3)

join = List.Join()  # unwired: list0
